# Dynamo graph DynamoBRobot_BasicOffline.dyn (Dynamo 1.0.0.1126)

newRobot = EXAMPLE_DynamoBRobot.DynamoBRobot.NewRobot()
integer_slider = IntegerSlider(100, range=0..100 step 1)
integer_slider_2 = IntegerSlider(5, range=0..100 step 1)
number_slider = DoubleSlider(220.1, range=0..1000 step 0.1)
number_slider_2 = DoubleSlider(267.6, range=0..1000 step 0.1)
number_slider_3 = DoubleSlider(222.7, range=0..1000 step 0.1)
byCoordinates = Point.ByCoordinates(x=number_slider, y=number_slider_2, z=number_slider_3)
number_slider_4 = DoubleSlider(6.75, range=-10..10 step 0.01)
number_slider_5 = DoubleSlider(4.54, range=-10..10 step 0.01)
number_slider_6 = DoubleSlider(-6.05, range=-10..10 step 0.01)
byCoordinates_2 = Vector.ByCoordinates(x=number_slider_4, y=number_slider_5, z=number_slider_6)
byOriginNormal = Plane.ByOriginNormal(origin=byCoordinates, normal=byCoordinates_2)
generateCode = EXAMPLE_DynamoBRobot.DynamoBRobot.GenerateCode(newRobot, integer_slider, integer_slider_2, byOriginNormal)
watch = Watch(generateCode)
string = StringInput("C:\DynamoBRobotCode.mod")
exportToFile = EXAMPLE_DynamoBRobot.DynamoBRobot.ExportToFile(generateCode, string)
watch_2 = Watch(exportToFile)
