# Dynamo graph DynamoBRobot_BasicOffline_SurfaceToMill.dyn (Dynamo 1.0.0.1126)

# group: Surface parameters
width = DoubleSlider(200, range=0..200 step 0.1)
length = DoubleSlider(200, range=0..200 step 0.1)
max_height = DoubleSlider(46.7, range=0..100 step 0.1)
u_control_points = IntegerSlider(3, range=0..10 step 1)
v_control_points = IntegerSlider(4, range=0..10 step 1)
baseX = DoubleSlider(200, range=-500..500 step 0.1)
baseY = DoubleSlider(50, range=-500..500 step 0.1)
baseZ = DoubleSlider(300, range=-500..500 step 0.1)

code_block = CodeBlock(width=width, length=length, maxHeight=max_height, uCount=u_control_points, vCount=v_control_points)  # frozen
# ---------- code_block.designscript (20 lines) ----------
wid = width;
len = length;
maxHeight = maxHeight;
uCount = uCount;
vCount = vCount;

ptCount = uCount * vCount;
randHeights = List.Chop(maxHeight * Math.RandomList(ptCount), vCount);
zVectors = Vector.ByCoordinates(0, 0, randHeights);

// ptsOnSrf = Point.ByCoordinates( (0..wid..#uCount)<1>, (0..len..#vCount)<2>) );
// ptsOnSrf.Z = randHeights;
  // uncomment this line to crash Dynamo...;

ptsOnSrf = Point.Add (
 Point.ByCoordinates( (0..wid..#uCount)<1>, (0..len..#vCount)<2>),
 zVectors
);

surf = Surface.ByLoft( NurbsCurve.ByPoints(ptsOnSrf) );
# ----------------------------------------

# group: Box properties
boxes_in_u = IntegerSlider(9, range=0..30 step 1)
boxes_in_v = IntegerSlider(7, range=0..30 step 1)
box_width = DoubleSlider(4.04, range=0..5 step 0.01)
box_length = DoubleSlider(4.96, range=0..5 step 0.01)

code_block_2 = CodeBlock(surface=code_block.surf, boxUCount=boxes_in_u, boxVCount=boxes_in_v, boxWidth=box_width, boxLength=box_length)  # frozen
# ---------- code_block_2.designscript (12 lines) ----------
surf = surface;
u = boxUCount;
v = boxVCount;
boxW = boxWidth;
boxL = boxLength;

srfPts = Surface.PointAtParameter( surf, (0..1..#u)<1>, (0..1..#v)<2> );
flrPts = Point.ByCoordinates(srfPts.X, srfPts.Y, 0);

basePlanes = Plane.ByOriginNormal(flrPts, Vector.ZAxis());
baseRects = Rectangle.ByWidthLength(basePlanes, boxW / 2, boxL / 2);
boxes = Curve.ExtrudeAsSolid(baseRects, srfPts.Z);
# ----------------------------------------

# group: Robot properties
speed = IntegerSlider(200, range=0..200 step 1)
zone = IntegerSlider(2, range=0..100 step 1)

# group: Surface generation
code_block_3 = CodeBlock { 1; }
sub = u_control_points - code_block_3
div = code_block_3 / sub
range = Range(end=code_block_3, step=div, lacing=Longest)
mul = width * range
watch = Watch(mul)
add = baseX + watch
sub_2 = v_control_points - code_block_3
div_2 = code_block_3 / sub_2
range_2 = Range(end=code_block_3, step=div_2, lacing=Longest)
mul_2 = length * range_2
watch_2 = Watch(mul_2)
add_2 = baseY + watch_2
byCoordinates = Point.ByCoordinates(x=add, y=add_2, lacing=CrossProduct)
flatten = Flatten(byCoordinates)
count = List.Count(flatten)
randomList = Math.RandomList(count)
mul_3 = randomList * max_height
count_2 = List.Count(range_2)

add_3 = baseZ + mul_3

# group (continued): Surface generation
byCoordinates_2 = Vector.ByCoordinates(z=add_3)
chop = List.Chop(list=byCoordinates_2, lengths=count_2)
add_4 = Point.Add(point=byCoordinates, vectorToAdd=chop)
byPoints = NurbsCurve.ByPoints(add_4)
byLoft = Surface.ByLoft(byPoints)

# group: Create blocks
watch_3 = Watch(byLoft)
range_3 = Range(end=boxes_in_u, lacing=Longest)
div_3 = range_3 / boxes_in_u
range_4 = Range(end=boxes_in_v, lacing=Longest)
div_4 = range_4 / boxes_in_v
pointAtParameter = Surface.PointAtParameter(surface=watch_3, u=div_3, v=div_4, lacing=CrossProduct)
normalAtParameter = Surface.NormalAtParameter(surface=watch_3, u=div_3, v=div_4, lacing=CrossProduct)
byOriginNormal = Plane.ByOriginNormal(origin=pointAtParameter, normal=normalAtParameter)

# group: Export ABB Code
newRobot = EXAMPLE_DynamoBRobot.DynamoBRobot.NewRobot()
flatten_2 = Flatten(byOriginNormal)
generateCode = EXAMPLE_DynamoBRobot.DynamoBRobot.GenerateCode(newRobot, speed, zone, flatten_2)
watch_4 = Watch(generateCode)
string = StringInput("C:\DynamoBRobotCode.mod")
exportToFile = EXAMPLE_DynamoBRobot.DynamoBRobot.ExportToFile(generateCode, string)
watch_5 = Watch(exportToFile)
